# Grasshopper definition Spiral.gh (Grasshopper 1.0.7)
# plug-ins: Kangaroo2 Components

pt = Point(Point(0, 0, 0))
number_slider = Slider(11, range=0..50)
cir = Circle(Plane="0,0,0", Radius=Slider(100, range=0..100))
sections = GetInteger(
    Slider(11, range=0..50),
    AtLeast=1,
    AtMost=1,
    Maximum=2147483647,
    Minimum=-2147483648,
    Prompt="sections",
    TreeAccess=False)
rotation = GetInteger(
    Slider(10, range=0..10),
    AtLeast=1,
    AtMost=1,
    Maximum=2147483647,
    Minimum=-2147483648,
    Prompt="rotation",
    TreeAccess=False)
divide = DivideCurve(Curve=cir, Count=sections, Kinks=False)  # -> Points, Tangents, Parameters
ln = Line(StartPoint="0,0,0", EndPoint=divide.Points)
addition = Addition(A=rotation, B="1")
divide_2 = DivideCurve(Curve=ln, Count=rotation, Kinks=False)  # -> simplify(Points), Tangents, Parameters
series = Series(Start=0, Step=rotation, Count=addition)  # -> simplify(Series)
rotate = Rotate(Geometry=divide_2.Points, Angle=degrees(series), Plane=pt)  # -> Geometry, Transform
pline = PolyLine(Vertices=rotate.Geometry, Closed=False)  # -> flatten(Polyline)
Z = UnitZ(Factor=Slider(10, range=0..10))
extr = Extrude(Base=pline, Direction=Z)
mesh = MeshBrep(
    Brep=extr,
    Settings={GridMaxCount=0, GridMinCount=16, JaggedSeams=False, MaxEdgeLength=0, MinEdgeLength=0.0001, MinTolerance=0, Refine=True, RefineAngle=0, RelativeTolerance=0.65, SimplePlanes=True, Tolerance=0})
clean = CombineClean(Meshes=mesh)
medges = MeshEdges(Mesh=clean)  # -> NakedEdges, InteriorEdges, NonManifoldEdges

# ---- group: convert lines to curves
crv = Curve([medges.NakedEdges, medges.InteriorEdges])

# ----
mesh_2 = Mesh(clean)
context_bake = ContextBake(Geometry=crv)
context_bake_2 = ContextBake(Geometry=mesh_2)
